# Grasshopper definition CORE 2023 CRASH COURSE DAY 6 - Pixel tower input and output.gh (Grasshopper 1.0.7)

reference_surface = Geometry(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)
# Define max. building envelope
recgrid = Rectangular(Plane=PlaneXY(0, 0, 0), SizeX="5.4", SizeY="5.4", ExtentX=Slider(6, range=0..10), ExtentY=Slider(8, range=0..10))  # -> Cells, Points
dom = ConstructDomain(DomainStart=expr("-0.5*x", "5.4"), DomainEnd=expr("0.5*x", "5.4"))
area = Area(Geometry=recgrid.Cells)  # -> Area, Centroid
Z = UnitZ(Factor=1)
project = ProjectPoint(Point=area.Centroid, Direction=Z, Geometry=reference_surface)  # -> Point, Index
dist = Distance(PointA=area.Centroid, PointB=project.Point)
box = DomainBox(Base=area.Centroid, X=dom, Y=dom, Z=dist)
px_volume = Geometry(box)
px_heights = Number(dist)
px_cpt = Point(area.Centroid)

# ----
# Load csv data
filepath_without_quotes = Panel("C:\Users\vK_Parametric\OneDrive\Documents\vK_Parametric\TUD\CORE 2023\CORE Crash Course files\Day6_PixelHeights_output.csv")
csv_writer = GhPythonScript(file_path=filepath_without_quotes, delimiter=";")  # -> data
# ---------- csv_writer: Python ----------
import ghpythonlib.treehelpers as th
import csv


data = list()
with open(file_path, "r") as f:
    reader = csv.reader(f, lineterminator='\n', delimiter=delimiter)
    for row in reader:
        data.append(row)
f.close()

data = th.list_to_tree(data)
# ---------- end csv_writer ----------
n_levels_per_px = Integer(csv_writer)

# ----
# Generate pixel tower
panel = Panel("5.4")

# ----
# Preview
px_cpt_2 = Point(px_cpt)
px_heights_2 = Number(px_heights)
expression = Expression(x=px_heights_2, Expression="Format(\"{0:0.0}\", x)")
Z_2 = UnitZ(Factor=px_heights_2)
move = Move(Geometry=px_cpt_2, Motion=Z_2)  # -> Geometry, Transform
tag = TextTag(Location=move.Geometry, Text=expression, Colour=ColourSwatch(SwatchColor=RGB(0, 0, 0)))

n_levels_per_px_2 = Integer(n_levels_per_px)
px_cpt_3 = Point(px_cpt)
vec = VectorXYZ(XComponent="80", YComponent="80", ZComponent=0)  # -> Vector, Length
generate_px_geo = Generate_px_geo(grid_size=panel, level_height="3.6", thickness_frames="0.5")  # -> box_2, facade_2, windows_2, roof_3
move_2 = Move(Geometry=px_cpt_3, Motion=vec.Vector)  # -> graft(Geometry), Transform
series = Series(Start=0, Step="3.6", Count=n_levels_per_px_2)
Z_3 = UnitZ(Factor=series)
move_3 = Move(Geometry=move_2.Geometry, Motion=Z_3)  # -> Geometry, Transform
windows = Geometry(generate_px_geo.windows_2)
frame = Geometry(generate_px_geo.facade_2)
roof = Geometry(generate_px_geo.roof_3)
orient = Orient(Geometry=frame, Source=PlaneXY(0, 0, 0), Target=move_3.Geometry)  # -> Geometry, Transform
orient_2 = Orient(Geometry=windows, Source=PlaneXY(0, 0, 0), Target=move_3.Geometry)  # -> Geometry, Transform
orient_3 = Orient(Geometry=roof, Source=PlaneXY(0, 0, 0), Target=move_3.Geometry)  # -> Geometry, Transform

# ----
# Write csv data
filepath_without_quotes_2 = Panel("C:\Users\vK_Parametric\OneDrive\Documents\vK_Parametric\TUD\CORE 2023\CORE Crash Course files\Day6_PixelHeights.csv")
px_heights_3 = Number(px_heights)
path_mapper = PathMapper(px_heights_3, source="{A;B;C}", target="{0;C}")
csv_writer_2 = GhPythonScript(file_path=filepath_without_quotes_2, data=path_mapper, delimiter=";")  # inputs data: tree
# ---------- csv_writer_2: Python ----------
import ghpythonlib.treehelpers as th
import csv

data = th.tree_to_list(data)


with open(file_path, "w") as f:
    writer = csv.writer(f, lineterminator='\n', delimiter=delimiter)
    writer.writerows(data)
f.close()
# ---------- end csv_writer_2 ----------

px_volume_2 = Geometry(px_volume)
edges = BrepEdges(Brep=px_volume_2)  # -> Naked, Interior, NonManifold
preview = CustomPreview(Geometry=px_volume_2, Material=ColourSwatch(SwatchColor=RGB(255, 255, 255)))

orient_4 = Orient(Geometry=generate_px_geo.box_2, Source=PlaneXY(0, 0, 0), Target=move_3.Geometry)  # -> Geometry, Transform

# ----
# Preview
px_volume_3 = Geometry(orient.Geometry)
edges_2 = BrepEdges(Brep=px_volume_3)  # -> Naked, Interior, NonManifold
preview_2 = CustomPreview(Geometry=px_volume_3, Material=ColourSwatch(SwatchColor=RGB(255, 255, 255)))
preview_3 = CustomPreview(Geometry=orient_2.Geometry, Material=ColourSwatch(SwatchColor=RGBA(98, 102, 133, 242)))
preview_4 = CustomPreview(Geometry=orient_3.Geometry, Material=ColourSwatch(SwatchColor=RGB(173, 252, 136)))

# ----
# Preview
px_volume_4 = Geometry(orient_4.Geometry)  # disabled
swatch = ColourSwatch(SwatchColor=RGB(255, 255, 255))  # disabled
edges_3 = BrepEdges(Brep=px_volume_4)  # -> Naked, Interior, NonManifold; disabled
preview_5 = CustomPreview(Geometry=px_volume_4, Material=swatch)  # disabled

# ==== cluster Generate_px_geo
level_height = ClusterInput()
thickness_frames = ClusterInput()
grid_size = ClusterInput()
level_height_2 = Number(level_height)
thickness_frames_2 = Number(thickness_frames)
grid_size_2 = Number(grid_size)
python = GhPythonScript(w=grid_size_2, t=thickness_frames_2)  # -> out, domains
# ---------- python: Python ----------
domains = list()


domains.append((0-w/2, t-w/2))
domains.append((w/2-t, w/2))
domains.append((w/2-t, w/2))



for i, d in enumerate(domains):
    domains[i] = "%s To %s" % d
# ---------- end python ----------
dom = ConstructDomain(DomainStart=expr("-0.5*x", grid_size_2), DomainEnd=expr("0.5*x", grid_size_2))
domain = Domain(python.domains)
item = ListItem(List=python.domains, Index=0, Wrap=True)  # -> Item, Item1, Item2, Item3
crossref = CrossReference(ListA=[item.Item, item.Item1], ListB=[item.Item, item.Item1], CrossMode=1)  # -> ListA, ListB
subtraction = Subtraction(A=level_height_2, B=thickness_frames_2)
subtraction_2 = Subtraction(A=grid_size_2, B=thickness_frames_2)
box = DomainBox(Base=PlaneXY(0, 0, 0), X=dom, Y=dom, Z=level_height_2)
dom_2 = ConstructDomain(DomainStart=thickness_frames_2, DomainEnd=subtraction_2)
dom_3 = ConstructDomain(DomainStart=thickness_frames_2, DomainEnd=subtraction)
debrep = DeconstructBrep(Brep=box)  # -> Faces, Edges, Vertices
box_2 = ClusterOutput(box)
dom² = ConstructDomain²(DomainU=dom_2, DomainV=dom_3)
split = SplitList(List=debrep.Faces, Index="4")  # -> ListA, ListB
join = BrepJoin(Breps=split.ListA)  # -> Breps, Closed
item_2 = ListItem(List=split.ListB, Index=0, Wrap=True)  # -> Item, Item1
subsrf = Isotrim(Surface=split.ListA, Domain=dom²)
splitmul = SplitBrepMultiple(Brep=join.Breps, Cutters=subsrf)
group = Group(Objects=subsrf)
roof = Geometry(item_2.Item1)
item_3 = ListItem(List=splitmul, Index=0, Wrap=True)  # -> Item1, Item
windows = Geometry(group)
facade = Geometry(item_3.Item1)
roof_2 = Geometry(roof)
facade_2 = ClusterOutput(facade)
windows_2 = ClusterOutput(windows)
roof_3 = ClusterOutput(roof_2)
